vi "index.gviweb"   [LabVIEW NXG 4.0.0]
panel controls:
  "ur for getting values from google firebase": string
  "url for sending values to google firebase": string
  "Relay control": bool
panel indicators:
  "Unit Consumed": i32
  "Amount to Pay": i32
  "Tab_2": i32
  "Linear Progress Bar_2": f64
  "URL Image": string
  "URL Image_2": string
  "URL Image_3": string
  "URL Image_4": string
uses:
  NI::HTTP::Open HTTP Handle.gvi
  NI::HTTP::GET.gvi
  NI::G Core::Strings::Search and Replace Pattern.gvi
  NI::HTTP::PUT Buffer.gvi
  NI::HTTP::Close HTTP Handle.gvi
diagram:
  call "Open HTTP Handle.gvi"() -> (client handle out=w1, error out=w2)
  while {
    call "GET.gvi"(client handle=w1, url=$"ur for getting values from google firebase", error in=w2) -> (client handle out=w3, body=w4, error out=w5)
    Search Or Split String(search string/char=",", string=w4) -> (match + rest of string=w6, substring before match=w7)
    Search Or Split String(search string/char="\",", string=w6) -> (match + rest of string=w8, substring before match=w9)
    call "Search and Replace Pattern.gvi"(string=w8, pattern="\"]") -> (result string=w10)
    call "Search and Replace Pattern.gvi"(string=w10, pattern="\",\"") -> (result string=w11)
    Decimal String To Number(string=w11) -> (number=w12)
    $Tab_2 <- w12
    Is Equal To 0(x=w12) -> w13
    Not(x=w13) -> w14
    Logical And(w14, $"Relay control") -> w15
    Select(s=w15, t=100, f=0) -> w16
    for (N = w16) (iteration -> i1) {
      Wait(time to wait=10)
      $"Linear Progress Bar_2" <- i1
    }
    call "Search and Replace Pattern.gvi"(string=w9, pattern=",\"") -> (result string=w17)
    Decimal String To Number(string=w17) -> (number=w18)
    $"Amount to Pay" <- w18
    Search Or Split String(search string/char="\"", string=w7) -> (match + rest of string=w19)
    call "Search and Replace Pattern.gvi"(string=w19, pattern="\"") -> (result string=w20)
    call "Search and Replace Pattern.gvi"(string=w20, pattern="\"") -> (result string=w21)
    Decimal String To Number(string=w21) -> (number=w22)
    $"Unit Consumed" <- w22
    Boolean To 0 Or 1(Boolean=$"Relay control") -> (0, 1=w23)
    Build Cluster(w23) -> w24
    Flatten To JSON(anything=w24) -> (JSON string=w25)
    call "PUT Buffer.gvi"(client handle=w3, url=$"url for sending values to google firebase", buffer=w25, error in=w5) -> (client handle out=w26, error out=w27)
    Wait(time to wait=100)
    stop if FALSE
  }
  call "Close HTTP Handle.gvi"(client handle=w26, error in=w27)
